# Grasshopper definition Test.gh (Grasshopper 1.0.8)
# plug-ins: ToggleV6, GrasshopperAgent

gh_tool_server = GHToolServer(
    Folder="C:\Users\Admin\Documents\GitHub\LangGraphAgent\GHTools",
    Port=5100,
    Active=Toggle(SpecialInteger=True),
    ShowInCanvas=False,
    KeepOpen=False,
    BakeToViewport=True)  # -> Status, Tools, URL, ToolDetails
panel = Panel(gh_tool_server.ToolDetails)
